vi "Add test to test set.gvi"   [LabVIEW NXG 2.1.0]
inputs:
  "Test Set": variant
  "name": string
  "VI reference": VIRefnum
  "error in_2": error
outputs:
  "Test Set Out": variant
  "error out": error
uses:
  NI::G Core::Error::Build Error Cluster.gvi
  Simple Tester::Set Test Ref.gvi
  Simple Tester::Set Test Name.gvi
  Simple Tester::Get Test Name.gvi
diagram:
  Is Empty String Or Path(string/path=$name) -> w1
  case (w1) {
    frame True {
      call "Build Error Cluster.gvi"(error in=$"error in_2", code=5001, description="Must provide a test name") -> (error out=w2)
      w3 = $"Test Set"
    }
    frame False {
      call "Set Test Ref.gvi"(VI reference=$"VI reference", error in=$"error in_2") -> (Test_2=w4, error out=w5)
      call "Set Test Name.gvi"(Test=w4, name=$name, error in=w5) -> (Test out=w6, error out=w7)
      call "Get Test Name.gvi"(variant=w6, error in=w7) -> (variant out=w8, name=w9, error out=w10)
      Set Variant Attribute(error in=w10, name=w9, value=w8, variant=$"Test Set") -> (error out=w11, replaced=w12, variant out=w3)
      case (w12) {
        frame False, Default {
          w2 = w11
        }
        frame True {
          call "Build Error Cluster.gvi"(error in=w11, code=5000, description="Tried to add a test with the same name as an existing one") -> (error out=w2)
        }
      }
    }
  }
  $"Test Set Out" <- w3
  $"error out" <- w2
