vi "Create Test Set Array.gvi"   [LabVIEW NXG 2.1.0]
inputs:
  "Test Set": variant
  "error in": error
outputs:
  "Output": "TestDisplay.gtype"[]
  "error out": error
  "Test Set Out": variant
types:
  "Test Status.gtype" = enum{"Disabled", "Scheduled", "Running", "Passed", "Failed"}
  "TestDisplay.gtype" = cluster{"Name": string, "Status": "Test Status.gtype", "Duration": f64}
uses:
  Simple Tester::Get All Tests.gvi
  Simple Tester::Get Test Name.gvi
diagram:
  call "Get All Tests.gvi"(Test Set=$"Test Set", error in=$"error in") -> (Test Set Out=w1, Tests=w2, error out=w3)
  $"Test Set Out" <- w1
  for {
    w4 = each element of w2
    call "Get Test Name.gvi"(variant=w4) -> (name=w6)
    Property Node(instance in="TestDisplay.gtype" {all zero or empty}, "Name"=w6, "Status"="Scheduled", "Duration"=0) -> (instance out=w7)
    append w7 to w5
  }
  $Output <- w5
  $"error out" <- w3
