vi "Error Handler - Event Handling Loop.gvi"   [LabVIEW NXG 2.1.0]
# Process an error that occurred in the Event Handling Loop, either by ignoring it, or generating an "Error" message.
inputs:
  "message queue in": Queue<"Message Cluster.gtype">, required
  "ignore errors (runtime)": i32[]
  "error in": error
outputs:
  "message queue out": Queue<"Message Cluster.gtype">
  "dup error in": error
types:
  "Message Cluster.gtype" = cluster{"Message": string, "Message Data": variant}
uses:
  Simple Tester::Check Loop Error.gvi
diagram:
  # Error Handler for the Event Handling Loop
  $"message queue out" <- $"message queue in"
  $"dup error in" <- $"error in"
  # The Ignore Errors (Static List) array constant should contain ignore errors that are defined at edit time. The Ignore Errors (Runtime) array can be dynamically generated at runtime.
  w1 = i32[] []  # Ignore Errors (Static List)
  # #CodeRecommended - Add errors to the array as follows:
  #
  # Ignore Errors - Do nothing. Discard the error completely.
  #
  # All other errors are treated as regular errors and are sent as "Error" messages to the Message Handling Loop for further processing.
  Build Array[ConcatenateInputs=True](w1, $"ignore errors (runtime)") -> w2
  call "Check Loop Error.gvi"(message queue in=$"message queue in", error to process=$"error in", ignore errors=w2)
