vi "Error Handler - Message Handling Loop.gvi"   [LabVIEW NXG 2.1.0]
# Process an error that occurred in the Message Handling Loop, either by ignoring it, or generating an "Exit" message.
inputs:
  "message queue in": Queue<"Message Cluster.gtype">, required
  "ignore errors (runtime)": i32[]
  "error in": error
outputs:
  "message queue out": Queue<"Message Cluster.gtype">
  "dup error in": error
types:
  "Message Cluster.gtype" = cluster{"Message": string, "Message Data": variant}
uses:
  Simple Tester::Check Loop Error.gvi
diagram:
  # Error Handler for the Message Handling Loop
  # #CodeRecommended - Errors that occur in the Message Handling Loop might place the application in an unknown state, and will cause the application to exit. In general, any error generated by the Message Handling Loop that can be handled without shutting down the QMH should be handled in the message itself because the QMH is not necessarily in a good state to process other messages. If you post an error message that does not exit, that should generally be for logging purposes only. Exceptions to this rule are for experienced programmers and should be reviewed with team members to check for race conditions.
  $"message queue out" <- $"message queue in"
  $"dup error in" <- $"error in"
  # The Ignore Errors (Static List) array constant should contain ignore errors that are defined at edit time. The Ignore Errors (Runtime) array can be dynamically generated at runtime.
  w1 = i32[] []  # Ignore Errors (Static List)
  Build Array[ConcatenateInputs=True](w1, $"ignore errors (runtime)") -> w2
  # #CodeRecommended - Add errors to the array as follows:
  #
  # Ignore Errors (Static List) - Do nothing. Discard the error completely.
  call "Check Loop Error.gvi"(exit on error=TRUE, message queue in=$"message queue in", error to process=$"error in", ignore errors=w2)
