vi "Get Test Ref.gvi"   [LabVIEW NXG 2.1.0]
inputs:
  "test": variant
  "error in": error
outputs:
  "found?": bool
  "ref": StrictVIRefnum<"function Test1.gvi">
  "error out": error
  "test_out": variant
uses:
  Simple Tester::MuckTest.gvi
diagram:
  call "MuckTest.gvi"() -> (VIReference=w1)
  Get Variant Attribute(default value=w1, error in=$"error in", name="ref", variant=$test) -> (error out=w2, found?=w3, value=w4, variant out=w5)
  $test_out <- w5
  $"found?" <- w3
  $ref <- w4
  $"error out" <- w2
