vi "Main.gvi"   [LabVIEW NXG 2.1.0]
# This template is for the Queued Message Handler design pattern.
# The Event Handling Loop generates messages based on user interface actions.
# The Message Handling Loop processes messages generated by the Event Handling Loop, or by other messages.  The messages are string values, so new messages can be added easily to the Message Cases case structure in the Message Handling Loop.  Each message cluster can also provide an optional value for Message Data, which is a variant that can be converted to whatever message-specific data is required.
panel controls:
  "Exit": bool
  "Test Run History": string[][]
  "Tests": "TestDisplay.gtype"[]
  "Enabled": bool[]
  "Run": bool
types:
  "Test Status.gtype" = enum{"Disabled", "Scheduled", "Running", "Passed", "Failed"}
  "TestDisplay.gtype" = cluster{"Name": string, "Status": "Test Status.gtype", "Duration": f64}
  "Model Event Type.gtype" = enum{"Test Started", "Test Finished", "Test Suite Started", "Test Suite Finished"}
  "Model Event.gtype" = cluster{"Event Type": "Model Event Type.gtype", "Event Data": variant}
  "UI Data.gtype" = cluster{"Boolean <Replace Me>": bool, "String <Replace Me>": string, "Numeric <Replace Me>": f64}
  T1 = cluster{"On": i32, "Of": i32, "Start": timestamp, "Passed": i32}
  T2 = cluster{"Element 1": variant, "Element 2": bool, "Element 3": u32, "Progress": T1}
uses:
  Simple Tester::Create All Message Queues.gvi
  Simple Tester::Dequeue Message.gvi
  Simple Tester::Get Test Ref.gvi
  Simple Tester::Enqueue Message (Single).gvi
  NI::G Core::Error::Display Error.gvi
  NI::G Core::Error::Build Error Cluster.gvi
  Simple Tester::Error Handler - Message Handling Loop.gvi
  Simple Tester::MuckTest.gvi
  Simple Tester::Add test to test set.gvi
  Simple Tester::Create Test Set Array.gvi
  Simple Tester::Get Test by Name.gvi
  Simple Tester::Set Test Display Status.gvi
  Simple Tester::Set Test Display Duration.gvi
  Simple Tester::Get Test Name.gvi
  Simple Tester::Error Handler - Event Handling Loop.gvi
diagram:
  disable {
    frame Disabled { }
    frame Enabled {
      w1 = bool FALSE  # Stop Event
      Create User Event[EventName="Model Event"](user event data type="Model Event.gtype" {all zero or empty}) -> (error out=w2, user event out=w3)
      w4 = bool FALSE  # Init Event
      Create User Event[EventName="Init Event"](error in=w2, user event data type=w4) -> (error out=w5, user event out=w6)
      Create User Event[EventName="Stop Event"](error in=w5, user event data type=w1) -> (error out=w7, user event out=w8)
      w9 = T1 {all zero or empty}  # Cluster Constant
      Register For Events("Stop Event"=w8, "Init Event"=w6, "Model Event"=w3, error in=w7) -> (error out=w10, event registration refnum out=w11)
      Generate User Event(error in=w10, event data=FALSE, user event=w6) -> (error out=w12)
      call "Create All Message Queues.gvi"(error in=w12) -> (message queues=w13, error out=w14)
      Property Node(instance in=w13) -> ("UI"=w15)
      # This is the Queued Message Handler design pattern. The Event Handling Loop generates messages based on user interface actions. The Message Handling Loop processes messages generated by the Event Handling Loop, or by other messages.  The messages are string values, so new messages can be added easily to the Message Cases case structure in the Message Handling Loop.  Each message cluster can also provide an optional value for Message Data, which is a variant that can be converted to whatever message-specific data is required.
      s1 = "UI Data.gtype" {all zero or empty}  # shift register
      s2 = w14  # shift register
      s3 = w9  # shift register
      while {
        call "Dequeue Message.gvi"(message queue in=w15, error in=s2) -> (message queue out=w16, message=w17, message data=w18, error out=w19)
        # s1: Data
        # w8: Stop Event
        case (w17) ignore case {  # Message Cases
          frame "Initialize" {
            # Bundle a sample string value.
            Property Node(instance in=s1, "String <Replace Me>"="Initial Message") -> (instance out=w21)
            w20 = w19
            w22 = default
            w23 = s3
          }
          frame "Run" {
            Variant To Data(type=variant[] [], variant=w18) -> (data=w24)
            Array Size(array=w24) -> (size(s)=w25)
            Property Node(instance in="Model Event.gtype" {all zero or empty}, "Event Type"="Test Suite Started", "Event Data"=w25) -> (instance out=w26)
            Generate User Event(event data=w26, user event=w3)
            s4 = w19  # shift register
            for {
              w27 = each element of w24
              call "Get Test Ref.gvi"(test=w27)
              call "Enqueue Message (Single).gvi"(message queue in=w16, message="Run Test", message data=w27, error in=s4) -> (error out=w28)
              next s4 = w28
            }
            Get Current Time() -> (current time=w29)
            Property Node(instance in=s3, "On"=0, "Of"=w25, "Start"=w29, "Passed"=0) -> (instance out=w23)
            w20 = s4
            w21 = s1
            w22 = default
          }
          frame "Run Test" {
            sequence (after w8) {
              frame 0 {
                call "Get Test Ref.gvi"(test=w18, error in=w19) -> (test_out=w30, ref=w31, error out=w32)
                Property Node(instance in=w31, error in=w32) -> ("Panel"=w33, error out=w34, instance out=w35)
                Property Node(instance in="Model Event.gtype" {all zero or empty}, "Event Type"="Test Started", "Event Data"=w18) -> (instance out=w36)
                Generate User Event(error in=w34, event data=w36, user event=w3) -> (error out=w37, user event out=w38)
                Property Node(instance in=w33, error in=w34) -> ("Window"=w39, error out=w40, instance out=w41)
                Open Window(error in=w40, reference in=w39) -> (error out=w42, reference out=w43)
                Property Node(instance in=s3) -> ("On"=w44, "Of"=w45, "Passed"=w46, "Start"=w47, instance out=w48)
                Increment(x=w44) -> w49
                Property Node(instance in=w48, "On"=w49) -> (instance out=w50)
                # w51: Last test?
                Is Equal(x=w49, y=w45) -> w51
              }
              frame 1 {
                Tick Count() -> (timer value=w52)
              }
              frame 2 {
                Call By Reference[CallByReferenceLoadType=0, CallByReferenceStyle=0](#ri=w35) -> (R1=w53, error out=w54)
              }
              frame 3 {
                Get Current Time() -> (current time=w55)
                Time Stamp Subtract(x=w55, y=w47) -> w56
                Property Node(instance in="Model Event.gtype" {all zero or empty}, "Event Data"=w56, "Event Type"="Test Suite Finished") -> (instance out=w57)
                Tick Count() -> (timer value=w58)
                Subtract(x=w58, y=w52) -> w59
                Increment(x=w46) -> w60
                Select(s=w53, t=w60, f=w46) -> w61
                Property Node(instance in=w50, "Passed"=w61) -> (instance out=w23)
                Build Cluster(w30, w53, w59, w23) -> w62
                Property Node(instance in="Model Event.gtype" {all zero or empty}, "Event Type"="Test Finished", "Event Data"=w62) -> (instance out=w63)
                Close Window(error in=w42, reference in=w43) -> (error out=w64, reference out=w65)
                Close Reference(error in=w64, reference=w65) -> (error out=w66)
                Close Reference(error in=w66, reference=w41) -> (error out=w67)
                Merge Errors(w67, w54) -> (error out=w68)
                Generate User Event(error in=w68, event data=w63, user event=w38) -> (error out=w69, user event out=w70)
                case (w51) {
                  frame False, Default {
                    w20 = w69
                  }
                  frame True {
                    Generate User Event(error in=w69, event data=w57, user event=w70) -> (error out=w20)
                  }
                }
              }
            }
            w21 = s1
            w22 = default
          }
          frame "Error" {
            Variant To Data(error in (no error)=w19, type=no error, variant=w18) -> (data=w71, error out=w20)
            # #CodeRecommended - Consider creating a system for logging errors in some way. These errors are for notification purposes only. Handling of specific errors should be performed in the message frames that generated the error.
            # #CodeRecommended - If you ever change the name of this "Error" message, you'll need to update the name in the Check Loop Error.vi as well.
            call "Display Error.gvi"(error in=w71)
            w21 = s1
            w22 = default
            w23 = s3
          }
          frame "Exit" {
            # Release the message queue reference
            Release Queue(error in=w19, queue=w16) -> (error out=w72)
            # #CodeNeeded - Add any required cleanup code here. Note that if 'Exit' was called as a result of an error, an error dialog will be displayed. Add any custom error handling for an 'Exit' condition here as well.
            Generate User Event(event data=TRUE, user event=w8) -> (error out=w73)
            Merge Errors(w73, w72) -> (error out=w20)
            # Stop the VI
            w21 = s1
            w22 = TRUE
            w23 = s3
          }
          frame Default {
            w74 = "The invalid message string \"%s\" was received in the Message Handling Loop."
            Format Into String(formatString=w74, w17) -> w75
            call "Build Error Cluster.gvi"(code=1, description=w75) -> (error out=w20)
            w21 = s1
            w22 = default
            w23 = s3
          }
        }
        call "Error Handler - Message Handling Loop.gvi"(message queue in=w16, error in=w20) -> (dup error in=w76)
        next s1 = w21
        next s2 = w76
        next s3 = w23
        stop if w22
      }
      call "MuckTest.gvi"() -> (VIReference=w77)
      s5 = variant()  # shift register
      s6 = uninitialised  # shift register
      for (N = 8) (iteration -> i1) {
        Format Into String(formatString="Test %0d.gvi", i1) -> w78
        call "Add test to test set.gvi"(Test Set=s5, name=w78, VI reference=w77, error in_2=s6) -> (Test Set Out=w79, error out=w80)
        next s5 = w79
        next s6 = w80
      }
      disable {
        frame Disabled { }
        frame Enabled {
          disable {
            frame Enabled { }
            frame Disabled { }
          }
          s7 = w11  # shift register
          while {
            event (dynamic events = s7) {
              on "Exit" Value changed {
                call "Enqueue Message (Single).gvi"(priority message=TRUE, message queue in=w15, message="Exit") -> (message queue out=w85, error out=w84)
                w83 = default
              }
              on "Dynamic" Stop Event {
                # The Message Handling Loop processed an "Exit" message, which fired this event to stop the Event Handling Loop.
                w83 = TRUE
                w84 = default
                w85 = w15
              }
              on "Window" Close? {
                Event Filter("Discard?"=TRUE)
                w83 = default
                w84 = default
                w85 = w15
              }
              on "Dynamic" Init Event {
                call "Create Test Set Array.gvi"(Test Set=s5, error in=s6) -> (Output=w86)
                $Tests <- w86
                $"Test Run History" <- string[][] []
                for (after w86) {
                  append TRUE to w87
                }
                $Enabled <- w87
                w83 = default
                w84 = default
                w85 = w15
              }
              on "Enabled" Value changed {
                Event Data() -> ("New Value"=w88)
                for {
                  w89 = each element of $Tests
                  w90 = each element of w88
                  Select(s=w90, t="Scheduled", f="Disabled") -> w92
                  Property Node(instance in=w89, "Status"=w92) -> (instance out=w93)
                  append w93 to w91
                }
                $Tests <- w91
                w83 = default
                w84 = default
                w85 = w15
              }
              on "Run" Value changed {
                s8 = s6  # shift register
                s9 = s5  # shift register
                s10 = $Tests  # shift register
                for {
                  w94 = each element of $Tests
                  Property Node(instance in=w94) -> ("Name"=w96, "Status"=w97)
                  case (w97) {
                    frame "Disabled" {
                      w103 = "Disabled"  # Test Status
                      w98 = s9
                      w99 = default
                      w100 = default
                      w101 = s8
                      w102 = w103
                    }
                    frame "Scheduled", Default {
                      call "Get Test by Name.gvi"(Test Set=s9, Name=w96, Error In=s8) -> (Test Set Out=w98, Test=w99, Found?=w100, Error Out=w101)
                      w102 = "Scheduled"
                    }
                  }
                  call "Set Test Display Status.gvi"(Tests=s10, Name=w96, Status=w102) -> (Tests Out=w104)
                  call "Set Test Display Duration.gvi"(Tests=w104, Name=w96, Duration=0) -> (Tests Out=w105)
                  append w99 to w95 if w100
                  next s8 = w101
                  next s9 = w98
                  next s10 = w105
                }
                $Tests <- s10
                call "Enqueue Message (Single).gvi"(message queue in=w15, message="Run", message data=w95, error in=s8) -> (message queue out=w85, error out=w84)
                w83 = default
              }
              on "Dynamic" Model Event {
                Event Data() -> ("Event Type"=w106, "Event Data"=w107)
                disable {
                  frame Disabled { }
                  frame Enabled {
                    case (w106) {
                      frame "Test Started" {
                        call "Get Test Name.gvi"(variant=w107, error in=s6) -> (name=w108, error out=w84)
                        call "Set Test Display Status.gvi"(Tests=$Tests, Name=w108, Status="Running") -> (Tests Out=w109)
                        $Tests <- w109
                      }
                      frame "Test Finished" {
                        Variant To Data(error in (no error)=s6, type=T2 {all zero or empty}, variant=w107) -> (data=w110, error out=w111)
                        Property Node(instance in=w110) -> ("Element 2"=w112, "Element 1"=w113, "Element 3"=w114, "Progress:On"=w115, "Progress:Of"=w116, "Progress:Passed"=w117)
                        call "Get Test Name.gvi"(variant=w113, error in=w111) -> (name=w118, error out=w84)
                        Select(s=w112, t="Passed", f="Failed") -> w119
                        call "Set Test Display Status.gvi"(Tests=$Tests, Name=w118, Status=w119) -> (Tests Out=w120)
                        call "Set Test Display Duration.gvi"(Tests=w120, Name=w118, Duration=w114) -> (Tests Out=w121)
                        $Tests <- w121
                        Format Into String(formatString="%d/%d", w115, w116) -> w122
                        Divide(x=w117, y=w115) -> w123
                        Multiply(100, w123) -> w124
                        Format Into String(formatString="%.0f%%", w124) -> w125
                        Replace Array Subset(inArray=$"Test Run History", index=0, index=1, new=w122, index=0, index=2, new=w125) -> w126
                        $"Test Run History" <- w126
                      }
                      frame "Test Suite Started" {
                        Variant To Data(error in (no error)=s6, type=i32 0, variant=w107) -> (data=w127, error out=w84)
                        Format Into String(formatString="0/%d", w127) -> w128
                        Get Current Time() -> (current time=w129)
                        Get Date And Time String(time stamp=w129, want seconds? (F)=TRUE) -> (time string=w130)
                        Build Array(w130, w128, "", "") -> w131
                        Insert Into Array(inArray=$"Test Run History", index0=0, new=w131) -> w132
                        $"Test Run History" <- w132
                      }
                      frame "Test Suite Finished" {
                        Variant To Data(type=f64 0, variant=w107) -> (data=w133)
                        Format Into String(formatString="%.3f s", w133) -> w134
                        Replace Array Subset(inArray=$"Test Run History", index=0, index=3, new=w134) -> w135
                        $"Test Run History" <- w135
                        w84 = s6
                      }
                      frame Default {
                        w84 = s6
                      }
                    }
                  }
                }
                w83 = default
                w85 = w15
              }
            }
            call "Error Handler - Event Handling Loop.gvi"(message queue in=w85, error in=w84) -> (dup error in=w81)
            stop if w83
          }
          w82 = s7
        }
      }
      Unregister For Events(error in=w81, event registration refnum=w82) -> (error out=w136)
      Merge Errors(w136, s2) -> (error out=w137)
      Destroy User Event(error in=w137, user event=w8) -> (error out=w138)
      call "Display Error.gvi"(error in=w138)
    }
  }
