vi "MuckTest.gvi"   [LabVIEW NXG 2.1.0]
outputs:
  "Pass": bool
panel indicators:
  "Chart": f64
uses:
  NI::G Core::Numeric::Random Number (Range) DBL.gvi
  NI::Analysis::Generation::Uniform White Noise (Scalar DBL).gvi
diagram:
  sequence {
    frame 0 {
      Property Node(instance in=reference to "Pass", "Visible"=FALSE) -> (instance out=w1)
    }
    frame 1 {
      call "Random Number (Range) DBL.gvi"(upper bound=7, lower bound=3) -> (number=w2)
      s1 = uninitialised  # shift register
      for (N = 100) (iteration -> i1) {
        Is Equal To 0(x=i1) -> w3
        call "Uniform White Noise (Scalar DBL).gvi"(state in=s1, reset=w3) -> (uniform white noise=w4, state out=w5)
        $Chart <- w4
        Wait(time to wait=w2)
        next s1 = w5
      }
    }
    frame 2 {
      Property Node(instance in=w1, "Visible"=TRUE)
      Random Number() -> (number (0 to 1)=w6)
      Is Greater(x=w6, y=0.5) -> w7
      $Pass <- w7
    }
    frame 3 {
      Wait(time to wait=500)
    }
  }
