vi "Set Test Display Status.gvi"   [LabVIEW NXG 2.1.0]
inputs:
  "Tests": "TestDisplay.gtype"[]
  "Name": string
  "Status": "Test Status.gtype" = "Disabled"
outputs:
  "Tests Out": "TestDisplay.gtype"[]
types:
  "Test Status.gtype" = enum{"Disabled", "Scheduled", "Running", "Passed", "Failed"}
  "TestDisplay.gtype" = cluster{"Name": string, "Status": "Test Status.gtype", "Duration": f64}
diagram:
  s1 = $Tests  # shift register
  for (iteration -> i1) {
    w1 = each element of $Tests
    Property Node(instance in=w1) -> ("Name"=w2)
    Is Equal(x=w2, y=$Name) -> w3
    case (w3) {
      frame False, Default {
        w4 = s1
      }
      frame True {
        in-place {
          Array Index Replace Read Poser(array=s1) -> (out0[i1]=w5)
          Property Node(instance in=w5, "Status"=$Status) -> (instance out=w6)
          Array Index Replace Write Poser(_, in=w6) -> (array=w4)
        }
      }
    }
    next s1 = w4
    stop if w3
  }
  $"Tests Out" <- s1
