vi "Set Test Ref.gvi"   [LabVIEW NXG 2.1.0]
inputs:
  "Test": variant
  "error in": error
  "VI reference": VIRefnum
outputs:
  "Test_2": variant
  "error out": error
uses:
  Simple Tester::MuckTest.gvi
diagram:
  call "MuckTest.gvi"() -> (VIReference=w1)
  To More Specific Class(reference=$"VI reference", target class=w1) -> w2
  Set Variant Attribute(error in=$"error in", name="ref", value=w2, variant=$Test) -> (error out=w3, variant out=w4)
  $Test_2 <- w4
  $"error out" <- w3
